# Grasshopper definition LatLon.ghx (Grasshopper 1.0.7)
# plug-ins: ElkGHComponents, Caribou

file_path = FilePath("Z:\Sites\Caribou\Caribou.Tests\Cases\simple.xml")
location = Location(FilePathText=file_path)  # -> OSMPointData, OSMFile, LongitudeDomain, LatitudeDomain
read_file = ReadFile(File=file_path, PerLineParse=False)
openstreetmap = OpenStreetMap(OSMContent=read_file, OSMFeatures="craft")  # -> Nodes, Ways, Debug
openstreetmap_2 = OpenStreetMap(OSMContent=read_file, OSMFeatures="amenity")  # -> Nodes, Ways, Debug
openstreetmap_3 = OpenStreetMap(OSMContent=read_file, OSMFeatures="building")  # -> Nodes, Ways, Debug
osm_data = OSMData(OSMPointData=location.OSMPointData, OSMFilePath=file_path, Feature="amenity", Generate3d=False, IndividualOutputs=False)  # -> Ways, FeatureKey
osm_data_2 = OSMData(OSMPointData=location.OSMPointData, OSMFilePath=file_path, Feature="building", Generate3d=False, IndividualOutputs=False)  # -> Ways, FeatureKey
osm_data_3 = OSMData(OSMPointData=location.OSMPointData, OSMFilePath=file_path, Feature="craft", Generate3d=False, IndividualOutputs=False)  # -> Ways, FeatureKey
geometry = Geometry(openstreetmap_3.Ways)
explode = Explode(Curve=geometry, Recursive=True)  # -> Segments, Vertices
panel = Panel(osm_data_3.Ways)
panel_2 = Panel(openstreetmap.Nodes)
panel_3 = Panel(osm_data.Ways)
panel_4 = Panel(osm_data_2.Ways)
panel_5 = Panel(openstreetmap_2.Nodes)
panel_6 = Panel(explode.Vertices)
