# Grasshopper definition Melbourne.ghx (Grasshopper 1.0.7)
# plug-ins: Caribou, ElkGHComponents

path = FilePath("Z:\Sites\Caribou\Caribou.Tests\Cases\melbourne.xml")
location = Location(FilePathText=path)  # -> OSMPointData, OSMFile, LongitudeDomain, LatitudeDomain
panel = Panel("amenity")
panel_2 = Panel("""amenity:restaurant
highway:residential""")
file = ReadFile(File=path, PerLineParse=False)
file_2 = ReadFile(File=path, PerLineParse=True)  # disabled
osm = OpenStreetMap(OSMContent=file, OSMFeatures="landuse")  # -> Nodes, Ways, Debug
osm_2 = OpenStreetMap(OSMContent=file_2, OSMFeatures=panel_2)  # -> Ways, Nodes, Debug; disabled
osm_data = OSMData(OSMPointData=location.OSMPointData, OSMFilePath=path, Feature="landuse", Generate3d=False, IndividualOutputs=False)  # -> Ways, FeatureKey
geometry = Geometry(osm.Nodes)
geometry_2 = Geometry(osm.Ways)
geometry_3 = Geometry(osm.Debug)
geometry_4 = Geometry(osm_data.Ways)
panel_3 = Panel(geometry)
panel_4 = Panel(geometry_2)
panel_5 = Panel(geometry_4)
panel_6 = Panel(osm_data.FeatureKey)
