# Grasshopper definition Caribou - Simple Example.ghx (Grasshopper 1.0.7)
# plug-ins: Caribou

specify_features = SpecifyFeatures(
    selectionHidesObscure=True,
    selectionSerialised="amenity=bicycle_parking,highway=footway,highway=primary,highway=residential,highway=secondary,highway=tertiary")  # -> OSMFeatures, Debug
specify_features_2 = SpecifyFeatures(selectionHidesObscure=True, selectionSerialised="building=*")  # -> OSMFeatures, Debug

# ---- group: Reference OSM download here
# NOTE!: If you want to see this example file in action, you will need to reference a downloaded Open Street Map xml file into the file path parameter to the right ->
path = FilePath("Z:\Sites\Caribou\OSM Test Data\nyc.osm")

# ----
extract_buildings = ExtractBuildings(OSMFilePath=path, OSMFeatures=specify_features_2.OSMFeatures, OutputHeighted=Slider(75, range=0..100))  # -> Buildings, Tags, Report, Bounds, Debug
extract_nodes = ExtractNodes(OSMFilePath=path, OSMFeatures=specify_features.OSMFeatures)  # -> Nodes, Tags, Report, Bounds, Debug
extract_ways = ExtractWays(OSMFilePath=path, OSMFeatures=specify_features.OSMFeatures)  # -> Ways, Tags, Report, Bounds, Debug
panel = Panel(extract_nodes.Tags)  # disabled
filter_tags = FilterTags(Items=extract_buildings.Buildings, Tags=extract_buildings.Tags, selectionHidesObscure=True)  # -> Items, Tags, Report, Debug
panel_2 = Panel(extract_ways.Report)  # disabled
custom_preview = CustomPreview(Geometry=filter_tags.Items, Material=ColourSwatch(SwatchColor=RGB(0, 217, 255)))

# ---- group: Visualise in Grasshopper with Per-Feature Colors
data = Data(extract_ways.Ways)  # disabled
data_2 = Data(extract_ways.Report)  # disabled
panel_3 = Panel("3")  # disabled
list_item = ListItem(List=data_2, Index=panel_3, Wrap=True)  # disabled

trim_tree = TrimTree(Tree=data, Depth=1)  # disabled

custom_preview_2 = CustomPreview(Geometry=trim_tree, Material=list_item)  # disabled
