# Grasshopper definition Copenhagen.ghx (Grasshopper 1.0.7)
# plug-ins: ElkGHComponents, PancakeContract, Caribou

# ---- group: Copenhagen XML File
path = FilePath("Z:\Sites\Caribou\Caribou.Tests\OSMxml\copenhagen-standard-export.osm")

# ---- group: Parse and Compare Amenity features of Node type
file_path = FilePath(path)
location = Location(FilePathText=file_path)  # -> OSMPointData, OSMFile, LongitudeDomain, LatitudeDomain
extract_nodes = ExtractNodes(OSMFilePath=file_path, OSMFeatures="amenity")  # -> Nodes, Tags, Report, Bounds, Debug
osm_data = OSMData(OSMPointData=location.OSMPointData, OSMFilePath=file_path, Feature="amenity", Generate3d=False, IndividualOutputs=False)  # -> Ways, FeatureKey
prune_tree = PruneTree(Tree=osm_data.Ways, Minimum=0, Maximum="2")  # -> flatten(Tree)
assert_same_content = AssertSameContent(_0=flatten(prune_tree), _1=flatten(extract_nodes.Nodes))  # -> Satisfied, ExtraInfo

# ----
panel = Panel("2")  # disabled
panel_2 = Panel("2")  # disabled
panel_3 = Panel("2")  # disabled

# ---- group: Parse and Compare Building features and Retail subfeatures of way type
file_path_2 = FilePath(path)
location_2 = Location(FilePathText=file_path_2)  # -> OSMPointData, OSMFile, LongitudeDomain, LatitudeDomain
extract_ways = ExtractWays(OSMFilePath=file_path_2, OSMFeatures="building=retail")  # -> Ways, Tags, Report, Bounds, Debug
osm_data_2 = OSMData(
    OSMPointData=location_2.OSMPointData,
    OSMFilePath=file_path_2,
    Feature="building",
    Generate3d=False,
    IndividualOutputs=False,
    SelectedTypes="retail")  # -> Ways, FeatureKey
explode = Explode(Curve=extract_ways.Ways, Recursive=True)  # -> Segments, flatten(Vertices)

# ----
osm_data_3 = OSMData(
    OSMPointData=location_2.OSMPointData,
    OSMFilePath=file_path_2,
    Feature="building",
    Generate3d=False,
    IndividualOutputs=True,
    SelectedTypes="retail")  # -> Retail, FeatureKey
prune_tree_2 = PruneTree(Tree=osm_data_2.Ways, Minimum="2", Maximum=0)  # -> flatten(Tree)
prune_tree_3 = PruneTree(Tree=osm_data_3.Retail, Minimum="2", Maximum=0)  # -> flatten(Tree)

# ---- group: Parse and Compare Building features and Retail subfeatures of way type (continued)
assert_same_content_2 = AssertSameContent(_0=flatten(prune_tree_2), _1=flatten(explode.Vertices), _2=prune_tree_3)  # -> Satisfied, ExtraInfo

# ---- group: Parse and Compare Craft features of Node type
file_path_3 = FilePath(path)
location_3 = Location(FilePathText=file_path_3)  # -> OSMPointData, OSMFile, LongitudeDomain, LatitudeDomain
extract_nodes_2 = ExtractNodes(OSMFilePath=file_path_3, OSMFeatures="craft")  # -> Nodes, Tags, Report, Bounds, Debug
osm_data_4 = OSMData(
    OSMPointData=location_3.OSMPointData,
    OSMFilePath=file_path_3,
    Feature="craft",
    Generate3d=False,
    IndividualOutputs=False)  # -> Ways, FeatureKey
panel_4 = Panel(extract_nodes_2.Nodes)

# ----
prune_tree_4 = PruneTree(Tree=osm_data_4.Ways, Minimum=0, Maximum="2")  # -> flatten(Tree)

# ---- group: Parse and Compare Craft features of Node type (continued)
panel_5 = Panel(prune_tree_4)
assert_same_content_3 = AssertSameContent(_0=flatten(osm_data_4.Ways), _1=flatten(panel_5))  # -> Satisfied, ExtraInfo

# ---- group: Parse and Compare Amenity features of Way type
file_path_4 = FilePath(path)
location_4 = Location(FilePathText=file_path_4)  # -> OSMPointData, OSMFile, LongitudeDomain, LatitudeDomain
extract_ways_2 = ExtractWays(OSMFilePath=file_path_4, OSMFeatures="amenity")  # -> Ways, Tags, Report, Bounds, Debug
osm_data_5 = OSMData(
    OSMPointData=location_4.OSMPointData,
    OSMFilePath=file_path_4,
    Feature="amenity",
    Generate3d=False,
    IndividualOutputs=False)  # -> Ways, FeatureKey
prune_tree_5 = PruneTree(Tree=osm_data_5.Ways, Minimum="2", Maximum=0)  # -> flatten(Tree)

# ----
explode_2 = Explode(Curve=extract_ways_2.Ways, Recursive=True)  # -> Segments, flatten(Vertices)

# ---- group: Parse and Compare Amenity features of Way type (continued)
assert_same_content_4 = AssertSameContent(_0=flatten(prune_tree_5), _1=flatten(explode_2.Vertices))  # -> Satisfied, ExtraInfo

# ---- group: Parse and Compare Building features of way type
file_path_5 = FilePath(path)  # disabled
read_file = ReadFile(File=file_path_5, PerLineParse=False)  # disabled
panel_6 = Panel("building")  # disabled
location_5 = Location(FilePathText=file_path_5)  # -> OSMPointData, OSMFile, LongitudeDomain, LatitudeDomain; disabled
osm_data_6 = OSMData(
    OSMPointData=location_5.OSMPointData,
    OSMFilePath=file_path_5,
    Feature="building",
    Generate3d=False,
    IndividualOutputs=False)  # -> Ways, FeatureKey; disabled

# ----
extract_ways_3 = ExtractWays(OSMContent=read_file, OSMFeatures=panel_6)  # -> Ways, Tags, Report, Debug, D; disabled
prune_tree_6 = PruneTree(Tree=osm_data_6.Ways, Minimum=panel, Maximum=0)  # -> flatten(Tree); disabled

# ---- group: Parse and Compare Building features of way type (continued)
explode_3 = Explode(Curve=extract_ways_3.Ways, Recursive=True)  # -> Segments, flatten(Vertices); disabled
assert_same_content_5 = AssertSameContent(_0=flatten(prune_tree_6), _1=flatten(explode_3.Vertices))  # -> Satisfied, ExtraInfo; disabled

# ---- group: Parse and Compare Building features of node type
# Caribou picks up extra items; perhaps because it's not filtering for a pre-defined set of building subtypes? Expected failure pending further investigation
file_path_6 = FilePath(path)  # disabled
read_file_2 = ReadFile(File=file_path_6, PerLineParse=False)  # disabled
panel_7 = Panel("building")  # disabled
location_6 = Location(FilePathText=file_path_6)  # -> OSMPointData, OSMFile, LongitudeDomain, LatitudeDomain; disabled
extract_ways_4 = ExtractWays(OSMContent=read_file_2, OSMFeatures=panel_7)  # -> Nodes, Tags, Report, Debug, D; disabled
osm_data_7 = OSMData(
    OSMPointData=location_6.OSMPointData,
    OSMFilePath=file_path_6,
    Feature="building",
    Generate3d=False,
    IndividualOutputs=False)  # -> Ways, FeatureKey; disabled

# ----
prune_tree_7 = PruneTree(Tree=osm_data_7.Ways, Minimum=0, Maximum=panel_2)  # -> flatten(Tree); disabled

# ---- group: Parse and Compare Building features of node type (continued)
assert_same_content_6 = AssertSameContent(_0=flatten(prune_tree_7), _1=flatten(extract_ways_4.Nodes))  # -> Satisfied, ExtraInfo; disabled

# ---- group: Parse and Compare Building features and Retail subfeatures of node type
# Caribou picks up extra items; perhaps because it's not filtering for a pre-defined set of building subtypes? Expected failure pending further investigation
file_path_7 = FilePath(path)  # disabled
panel_8 = Panel("building=retail")  # disabled
read_file_3 = ReadFile(File=file_path_7, PerLineParse=False)  # disabled
location_7 = Location(FilePathText=file_path_7)  # -> OSMPointData, OSMFile, LongitudeDomain, LatitudeDomain; disabled
openstreetmap = OpenStreetMap(OSMContent=read_file_3, OSMFeatures=panel_8)  # -> Nodes, Ways, Debug, Debug_2, Debug_3; disabled

# ----
osm_data_8 = OSMData(
    OSMPointData=location_7.OSMPointData,
    OSMFilePath=file_path_7,
    Feature="building",
    Generate3d=False,
    IndividualOutputs=False)  # -> Ways, FeatureKey; disabled
prune_tree_8 = PruneTree(Tree=osm_data_8.Ways, Minimum=0, Maximum=panel_3)  # disabled

# ---- group: Parse and Compare Building features and Retail subfeatures of node type (continued)
assert_same_content_7 = AssertSameContent(_0=flatten(prune_tree_8), _1=flatten(openstreetmap.Nodes))  # -> Satisfied, ExtraInfo; disabled
