# Grasshopper definition LatLon.ghx (Grasshopper 1.0.7)
# plug-ins: ElkGHComponents, PancakeContract, Urbano, Caribou

# ---- group: Simple XML FIle
file_path = FilePath("Z:\Sites\Caribou\Caribou.Tests\OSMxml\simple.xml")

# ---- group: Parse and Compare Amenity features
file_path_2 = FilePath(file_path)
location = Location(FilePathText=file_path_2)  # -> OSMPointData, OSMFile, LongitudeDomain, LatitudeDomain
extract_nodes = ExtractNodes(OSMFilePath=file_path_2, OSMFeatures="amenity")  # -> Nodes, Tags, Report, Bounds, Debug
import_osm_features = ImportOSMFeatures(OSMPathOrURL=file_path_2, OSMFeatureType="amenity", Format="xml", ImportAltitude=False)  # -> Points, Metadata, UTMZone, TranslationVector
osm_data = OSMData(
    OSMPointData=location.OSMPointData,
    OSMFilePath=file_path_2,
    Feature="amenity",
    Generate3d=False,
    IndividualOutputs=False)  # -> Ways, FeatureKey
project_geographic_point = ProjectGeographicPoint(Point=import_osm_features.Points, Projection="WSG84 -> UTM", UTMZone=import_osm_features.UTMZone)  # -> Out, UTMZone
panel = Panel(osm_data.Ways)
assert_same_content = AssertSameContent(_0=osm_data.Ways, _1=extract_nodes.Nodes)  # -> Satisfied, ExtraInfo

# ---- group: Parse and Compare Building features
file_path_3 = FilePath(file_path)
location_2 = Location(FilePathText=file_path_3)  # -> OSMPointData, OSMFile, LongitudeDomain, LatitudeDomain
extract_nodes_2 = ExtractNodes(OSMFilePath=file_path_3, OSMFeatures="building")  # -> Nodes, Tags, Report, Bounds, Debug
extract_ways = ExtractWays(OSMFilePath=file_path_3, OSMFeatures="building")  # -> Ways, Tags, Report, Bounds, Debug
import_osm_features_2 = ImportOSMFeatures(OSMPathOrURL=file_path_3, OSMFeatureType="building", Format="xml", ImportAltitude=False)  # -> Points, Metadata, UTMZone, TranslationVector
osm_data_2 = OSMData(
    OSMPointData=location_2.OSMPointData,
    OSMFilePath=file_path_3,
    Feature="building",
    Generate3d=False,
    IndividualOutputs=False)  # -> Ways, FeatureKey
project_geographic_point_2 = ProjectGeographicPoint(Point=import_osm_features_2.Points, Projection="WSG84 -> UTM", UTMZone=import_osm_features_2.UTMZone)  # -> Out, UTMZone
prune_tree = PruneTree(Tree=osm_data_2.Ways, Minimum=0, Maximum=2)
explode = Explode(Curve=extract_ways.Ways, Recursive=True)  # -> Segments, Vertices
prune_tree_2 = PruneTree(Tree=osm_data_2.Ways, Minimum=2, Maximum=0)
assert_same_content_2 = AssertSameContent(_0=flatten(extract_nodes_2.Nodes), _1=flatten(prune_tree))  # -> Satisfied, ExtraInfo
assert_same_content_3 = AssertSameContent(_0=flatten(explode.Vertices), _1=flatten(prune_tree_2))  # -> Satisfied, ExtraInfo

# ---- group: Parse and Compare Craft features
# Elk doesn't pick-up the falcony example (as it's not a defined craft?) so only compare the matching item
file_path_4 = FilePath(file_path)
location_3 = Location(FilePathText=file_path_4)  # -> OSMPointData, OSMFile, LongitudeDomain, LatitudeDomain
extract_nodes_3 = ExtractNodes(OSMFilePath=file_path_4, OSMFeatures="craft")  # -> Nodes, Tags, Report, Bounds, Debug
osm_data_3 = OSMData(
    OSMPointData=location_3.OSMPointData,
    OSMFilePath=file_path_4,
    Feature="craft",
    Generate3d=False,
    IndividualOutputs=False)  # -> Ways, FeatureKey
prune_tree_3 = PruneTree(Tree=osm_data_3.Ways, Minimum=0, Maximum=Slider(1, range=0..1))
panel_2 = Panel(prune_tree_3)

# ----
list_item = ListItem(List=extract_nodes_3.Nodes, Index=0, Wrap=True)

# ---- group: Parse and Compare Craft features (continued)
assert_same_content_4 = AssertSameContent(_0=prune_tree_3, _1=list_item)  # -> Satisfied, ExtraInfo
