# Grasshopper definition Simple.ghx (Grasshopper 1.0.7)
# plug-ins: PancakeContract, Caribou

# ---- group: Simple XML File
path = FilePath("Z:\Sites\Caribou\Caribou.Tests\Grasshopper\Simple.ghx")

# ---- group: Parse and Compare Craft features of Node type
file_path = FilePath(path)
extract_nodes = ExtractNodes(OSMFilePath=file_path, OSMFeatures="craft=*")  # -> Nodes, Tags, Report, Bounds, Debug
assert_same_content = AssertSameContent(_0=flatten(extract_nodes.Nodes))  # -> Satisfied, ExtraInfo

# ---- group: Parse and Compare Building features of way type
file_path_2 = FilePath(path)
panel = Panel("building")
explode = Explode(Recursive=True)  # -> Segments, flatten(Vertices)
assert_same_content_2 = AssertSameContent(_1=flatten(explode.Vertices))  # -> Satisfied, ExtraInfo

# ---- group: Parse and Compare Building features and Retail subfeatures of way type
file_path_3 = FilePath(path)
panel_2 = Panel("building=retail")
explode_2 = Explode(Recursive=True)  # -> Segments, flatten(Vertices)
assert_same_content_3 = AssertSameContent(_1=flatten(explode_2.Vertices))  # -> Satisfied, ExtraInfo

# ----
extract_ways = ExtractWays(OSMFilePath=file_path_2, OSMFeatures=panel)  # -> Ways, Tags, Report, Bounds, Debug
extract_ways_2 = ExtractWays(OSMFilePath=file_path_3, OSMFeatures=panel_2)  # -> Ways, Tags, Report, Bounds, Debug
explode_3 = Explode(Recursive=True)  # -> Segments, flatten(Vertices)

# ---- group: Parse and Compare Amenity features of Way type
file_path_4 = FilePath(path)
panel_3 = Panel("amenity")
assert_same_content_4 = AssertSameContent(_1=flatten(explode_3.Vertices))  # -> Satisfied, ExtraInfo

# ----
extract_ways_3 = ExtractWays(OSMFilePath=file_path_4, OSMFeatures=panel_3)  # -> Ways, Tags, Report, Bounds, Debug

# ---- group: Parse and Compare Building features and Retail subfeatures of way type
file_path_5 = FilePath(path)
panel_4 = Panel("building=retail")

# ---- group: Parse and Compare Amenity features of Way type
file_path_6 = FilePath(path)
panel_5 = Panel("amenity")

# ---- group: Parse and Compare Building features of way type
file_path_7 = FilePath(path)
panel_6 = Panel("building")

# ----
extract_buildings = ExtractBuildings(OSMFilePath=file_path_6, OSMFeatures=panel_5)  # -> Buildings, Tags, Report, Bounds, Debug
extract_buildings_2 = ExtractBuildings(OSMFilePath=file_path_5, OSMFeatures=panel_4)  # -> Buildings, Tags, Report, Bounds, Debug
extract_buildings_3 = ExtractBuildings(OSMFilePath=file_path_7, OSMFeatures=panel_6)  # -> Buildings, Tags, Report, Bounds, Debug

# ---- group: Parse and Compare Building features of node type
# Caribou picks up extra items; perhaps because it's not filtering for a pre-defined set of building subtypes? Expected failure pending further investigation
panel_7 = Panel("building")
file_path_8 = FilePath(path)

# ----
extract_nodes_2 = ExtractNodes(OSMFilePath=file_path_8, OSMFeatures=panel_7)  # -> Nodes, Tags, Report, Bounds, Debug

# ---- group: Parse and Compare Building features of node type (continued)
assert_same_content_5 = AssertSameContent(_1=flatten(extract_nodes_2.Nodes))  # -> Satisfied, ExtraInfo; disabled

# ---- group: Parse and Compare Building features and Retail subfeatures of node type
# Caribou picks up extra items; perhaps because it's not filtering for a pre-defined set of building subtypes? Expected failure pending further investigation
file_path_9 = FilePath(path)
panel_8 = Panel("building=retail")

# ----
extract_nodes_3 = ExtractNodes(OSMFilePath=file_path_9, OSMFeatures=panel_8)  # -> Nodes, Tags, Report, Bounds, Debug

# ---- group: Parse and Compare Building features and Retail subfeatures of node type (continued)
assert_same_content_6 = AssertSameContent(_1=flatten(extract_nodes_3.Nodes))  # -> Satisfied, ExtraInfo; disabled

# ---- group: Parse and Compare Amenity features of Node type
# Caribou picks up extra items; perhaps because it's not filtering for a pre-defined set of craft subtypes? Expected failure pending further investigation
file_path_10 = FilePath(path)
panel_9 = Panel("""amenity=animal_boarding,
amenity=animal shelter,
amenity=arts_centre,
amenity=atm,
amenity=baby_hatch ,
amenity=bank,
amenity=bar,
amenity=bbq ,
amenity=bench,
amenity=bicycle_parking,""")

# ----
extract_nodes_4 = ExtractNodes(OSMFilePath=file_path_10, OSMFeatures=panel_9)  # -> Nodes, Tags, Report, Bounds, Debug

# ---- group: Parse and Compare Amenity features of Node type (continued)
assert_same_content_7 = AssertSameContent(_1=flatten(extract_nodes_4.Nodes))  # -> Satisfied, ExtraInfo; disabled
