# Grasshopper definition Caribou - Simple Example.ghx (Grasshopper 1.0.7)
# plug-ins: Caribou

panel = Panel("cuisine=mexican")
panel_2 = Panel("highway=traffic_signals")
panel_3 = Panel("addr:street=Taranaki Street")
specify_features = SpecifyFeatures(selectionIncludesObscure=True, selectionSerialised="craft=*,emergency=*,healthcare=*,highway=*,historic=*,landuse=*")  # -> OSMFeatures, Debug

# ---- group: Melbourne CBD
path = FilePath(["Z:\Sites\Caribou\Caribou.Tests\Cases\melbourne.xml", "/Users/philip/Sites/Caribou/Caribou.Tests/Cases/melbourne.xml"])

# ---- group: Wellington CBD
path_2 = FilePath(["/Users/philip/Sites/Caribou/Caribou.Tests/Cases/wellington-overpass-export.osm", "Z:\Sites\Caribou\Caribou.Tests\Cases\wellington-overpass-export.osm"])

# ----
path_3 = FilePath(path_2)
text = Text(specify_features.OSMFeatures)
extract_ways = ExtractWays(OSMFilePath=path_3, OSMFeatures=text)  # -> Ways, Tags, Report, Debug
extract_nodes = ExtractNodes(OSMFilePath=path_3, OSMFeatures=text)  # -> Nodes, Tags, Report, Debug
extract_buildings = ExtractBuildings(OSMFilePath=path_3, OSMFeatures=["building=office", "building=apartments"])  # -> Buildings, Tags, Report, Debug

# ---- group: Visualise in Grasshopper with Per-Feature Colors
data = Data(extract_ways.Ways)
data_2 = Data(extract_ways.Report)
list_item = ListItem(List=data_2, Index="3", Wrap=True)
custom_preview = CustomPreview(Geometry=data, Material=list_item)

data_3 = Data(extract_nodes.Nodes)
data_4 = Data(extract_nodes.Report)
list_item_2 = ListItem(List=data_4, Index="3", Wrap=True)
custom_preview_2 = CustomPreview(Geometry=data_3, Material=list_item_2)

data_5 = Data(extract_buildings.Buildings)
data_6 = Data(extract_buildings.Report)
list_item_3 = ListItem(List=data_6, Index="3", Wrap=True)
custom_preview_3 = CustomPreview(Geometry=data_5, Material=list_item_3)

# ---- group: Make a key to be shown in Rhino with Per-Feature Colors and Counts
data_7 = Data(extract_nodes.Report)
list_item_4 = ListItem(List=data_7, Index="0", Wrap=True)
list_item_5 = ListItem(List=data_7, Index="2", Wrap=True)
text_join = TextJoin(Text=[list_item_4, list_item_5], Join=", ")  # -> flatten(Result)
list_item_6 = ListItem(List=data_7, Index="3", Wrap=True)  # -> flatten(Item)
rectangle = Rectangle({Plane=PlaneXY(3149691.735, 3877203.159, 0), Size=Domain2(u=-531927.6234..531927.6234, v=-869497.0767..869497.0767)})
legend = Legend(Colour=list_item_6, Tags=text_join, Rectangle=rectangle, LegendType=1)
